# Grasshopper definition divSurfaceByLength01.gh (Grasshopper 0.9.76)

srf = Surface(<surface referenced from the Rhino model>)
edges = BrepEdges(Brep=srf)  # -> Naked, Interior, NonManifold
data = Data(edges.Naked)
item = ListItem(List=data, Index=0, Wrap=True)  # -> Item1, Item, Item1_2
divdist = DivideDistance(Curve=[item.Item, item.Item1], Distance=[Slider(10, range=0..10), Slider(4, range=0..10)])  # -> Points, Tangents, Parameters
srf_cp = SurfaceClosestPoint(Point=divdist.Points, Surface=srf)  # -> Point, UVPoint, Distance
iso = IsoCurve(Surface=srf, UVPoint=srf_cp.UVPoint)  # -> UIsocurve, VIsocurve
srfsplit = SurfaceSplit(Surface=srf, Curves=flatten([iso.UIsocurve, iso.VIsocurve]))
