# Grasshopper definition divSurfaceByLength02.gh (Grasshopper 1.0.7)

crv = Curve(<curve referenced from the Rhino model>)
Z = UnitZ(Factor=Slider(5000, range=0..10000))
# BY HS_KIM
extr = Extrude(Base=crv, Direction=Z)
# BY MICHAEL
srf = Surface(extr)
edges = BrepEdges(Brep=srf)  # -> Naked, Interior, NonManifold
srf_2 = Surface(extr)
data = Data(edges.Naked)
u_distance = Slider(239, range=0..500)
v_distance = Slider(500, range=0..500)
item = ListItem(List=data, Index=0, Wrap=True)  # -> Item1, Item, Item1_2
edges_2 = BrepEdges(Brep=srf_2)  # -> Naked, Interior, NonManifold
divdist = DivideDistance(Curve=[item.Item, item.Item1], Distance=[Slider(399, range=0..500), Slider(771, range=0..1000)])  # -> Points, Tangents, Parameters
item_2 = ListItem(List=edges_2.Naked, Index=0, Wrap=True)  # -> Item, Item1
srf_cp = SurfaceClosestPoint(Point=divdist.Points, Surface=srf)  # -> Point, UVPoint, Distance
divdist_2 = DivideDistance(Curve=reparameterize(item_2.Item), Distance=u_distance)  # -> Points, Tangents, flatten(Parameters)
divdist_3 = DivideDistance(Curve=reparameterize(item_2.Item1), Distance=v_distance)  # -> Points, Tangents, flatten(Parameters)
end = EndPoints(Curve=item_2.Item1)  # -> Start, End
iso = IsoCurve(Surface=srf, UVPoint=srf_cp.UVPoint)  # -> UIsocurve, VIsocurve
num = Number(1)
srfsplit = SurfaceSplit(Surface=srf, Curves=flatten([iso.UIsocurve, iso.VIsocurve]))
merge = Merge(Data1=divdist_2.Parameters, Data2=num)
merge_2 = Merge(Data1=divdist_3.Parameters, Data2=num)
cset = CreateSet(List=merge)  # -> Set, Map
toggle = BooleanToggle(False)
cset_2 = CreateSet(List=merge_2)  # -> Set, Map
consec = ConsecutiveDomains(Numbers=cset.Set, Additive=toggle)
consec_2 = ConsecutiveDomains(Numbers=cset_2.Set, Additive=toggle)
graft = GraftTree(Tree=consec, IncludeEmptyLists=True, IncludeNullItems=True)
lng = ListLength(List=consec_2)
lng_2 = ListLength(List=consec)
multiplication = Multiplication(A=lng_2, B=lng)
repeat = RepeatData(Data=graft, Length=lng)  # -> flatten(Data)
repeat_2 = RepeatData(Data=consec_2, Length=multiplication)  # -> flatten(Data)
dom = ConstructDomain(DomainU=repeat, DomainV=repeat_2)
subsrf = Isotrim(Surface=reparameterize(srf_2), Domain=dom)

pt = Point(flatten([end.Start, divdist_2.Points]))
pt_2 = Point(flatten([end.End, divdist_3.Points]))
srf_cp_2 = SurfaceClosestPoint(Point=pt, Surface=srf_2)  # -> Point, UVPoint, Distance
srf_cp_3 = SurfaceClosestPoint(Point=pt_2, Surface=srf_2)  # -> Point, UVPoint, Distance
iso_2 = IsoCurve(Surface=srf_2, UVPoint=srf_cp_3.UVPoint)  # -> UIsocurve, VIsocurve
iso_3 = IsoCurve(Surface=srf_2, UVPoint=srf_cp_2.UVPoint)  # -> UIsocurve, VIsocurve

# ---- group: Your Curves
crv_2 = Curve(flatten(iso_3.VIsocurve))
crv_3 = Curve(flatten(iso_2.UIsocurve))

# ----
ccx = CurveCurve(CurveA=crv_2, CurveB=graft(crv_3))  # -> Points, ParamsA, ParamsB

# ---- group: Your Points
pt_3 = Point(flatten(ccx.Points))
