# Grasshopper definition panel01-morph.gh (Grasshopper 1.0.7)

curve = Curve(<curve referenced from the Rhino model>)

surface = Surface(<surface referenced from the Rhino model>)
divide_surface = DivideSurface(Surface=surface, UCount="15", VCount="11")  # -> Points, Normals, Parameters

curve_closest_point = CurveClosestPoint(Point=flatten(divide_surface.Points), Curve=curve)  # -> Point, Parameter, Distance
larger_than = LargerThan(FirstNumber=curve_closest_point.Distance, SecondNumber="5")  # -> LargerThan, OrEqualTo
smaller_than = SmallerThan(FirstNumber=curve_closest_point.Distance, SecondNumber="5")  # -> SmallerThan, OrEqualTo
cull_pattern = CullPattern(List=flatten(divide_surface.Points), CullPattern=smaller_than.OrEqualTo)
cull_pattern_2 = CullPattern(List=flatten(divide_surface.Points), CullPattern=larger_than.LargerThan)

surface_closest_point = SurfaceClosestPoint(Point=cull_pattern, Surface=surface)  # -> Point, UVPoint, Distance
geometry = Geometry(<brep referenced from the Rhino model>)
area = Area(Geometry=geometry)  # -> Area, Centroid
evaluate_surface = EvaluateSurface(Surface=surface, Point=surface_closest_point.UVPoint)  # -> Point, Normal, UDirection, VDirection, Frame
xy_plane = XYPlane(Origin=area.Centroid)
orient = Orient(Geometry=geometry, Source=xy_plane, Target=evaluate_surface.Frame)  # -> Geometry, Transform

curve_closest_point_2 = CurveClosestPoint(Point=flatten(cull_pattern_2), Curve=curve)  # -> Point, Parameter, Distance
smaller_than_2 = SmallerThan(FirstNumber=curve_closest_point_2.Distance, SecondNumber="10")  # -> SmallerThan, OrEqualTo
larger_than_2 = LargerThan(FirstNumber=curve_closest_point.Distance, SecondNumber="10")  # -> LargerThan, OrEqualTo
cull_pattern_3 = CullPattern(List=flatten(cull_pattern_2), CullPattern=smaller_than_2.SmallerThan)
cull_pattern_4 = CullPattern(List=flatten(divide_surface.Points), CullPattern=larger_than_2.LargerThan)

surface_closest_point_2 = SurfaceClosestPoint(Point=cull_pattern_4, Surface=surface)  # -> Point, UVPoint, Distance
geometry_2 = Geometry(<brep referenced from the Rhino model>)
area_2 = Area(Geometry=geometry_2)  # -> Area, Centroid
evaluate_surface_2 = EvaluateSurface(Surface=surface, Point=surface_closest_point_2.UVPoint)  # -> Point, Normal, UDirection, VDirection, Frame
xy_plane_2 = XYPlane(Origin=area_2.Centroid)
orient_2 = Orient(Geometry=geometry_2, Source=xy_plane_2, Target=evaluate_surface_2.Frame)  # -> Geometry, Transform

surface_closest_point_3 = SurfaceClosestPoint(Point=cull_pattern_3, Surface=surface)  # -> Point, UVPoint, Distance
geometry_3 = Geometry(<brep referenced from the Rhino model>)
area_3 = Area(Geometry=geometry_3)  # -> Area, Centroid
evaluate_surface_3 = EvaluateSurface(Surface=surface, Point=surface_closest_point_3.UVPoint)  # -> Point, Normal, UDirection, VDirection, Frame
xy_plane_3 = XYPlane(Origin=area_3.Centroid)
orient_3 = Orient(Geometry=geometry_3, Source=xy_plane_3, Target=evaluate_surface_3.Frame)  # -> Geometry, Transform
