# Grasshopper definition panel02.gh (Grasshopper 1.0.7)

unit_z = UnitZ(Factor=Slider(50, range=0..100))
curve = Curve(<curve referenced from the Rhino model>)
extrude = Extrude(Base=curve, Direction=unit_z)

edges = BrepEdges(Brep=extrude)  # -> Naked, Interior, NonManifold
data = Data(edges.Naked)
item = ListItem(List=data, Index=0, Wrap=True)  # -> Item1, Item, Item1_2
divdist = DivideDistance(Curve=[item.Item, item.Item1], Distance=[Slider(3, range=0..10), Slider(4, range=0..10)])  # -> Points, Tangents, Parameters
srf_cp = SurfaceClosestPoint(Point=divdist.Points, Surface=extrude)  # -> Point, UVPoint, Distance
iso = IsoCurve(Surface=extrude, UVPoint=srf_cp.UVPoint)  # -> UIsocurve, VIsocurve
srfsplit = SurfaceSplit(Surface=extrude, Curves=flatten([iso.UIsocurve, iso.VIsocurve]))

area = Area(Geometry=srfsplit)  # -> Area, Centroid
surface = Surface(extrude)
curve_2 = Curve(<curve referenced from the Rhino model>)

Y = UnitY(Factor=1)
crv = Curve(curve_2)
mesh = Mesh(surface)
projecttomesh = CSharpScript(curve=crv, mesh=mesh, dir=Y)  # -> out, A; inputs curve: Curve, mesh: Mesh, dir: Vector3d
# ---------- projecttomesh: C# usings ----------
using System.IO;
using System.Linq;
using System.Data;
using System.Drawing;
using System.Reflection;
using System.Windows.Forms;
using System.Xml;
using System.Xml.Linq;
using System.Runtime.InteropServices;

using Rhino.DocObjects;
using Rhino.Collections;
using GH_IO;
using GH_IO.Serialization;
# ---------- projecttomesh: C# ----------
    if (null != curve && null != mesh && dir.IsValid)
    {
      var tol = RhinoDoc.ActiveDoc.ModelAbsoluteTolerance;
      A = Curve.ProjectToMesh(curve, mesh, dir, tol);
    }
# ---------- end projecttomesh ----------

curve_closest_point = CurveClosestPoint(Point=area.Centroid, Curve=projecttomesh.A)  # -> Point, Parameter, Distance
smaller_than = SmallerThan(FirstNumber=curve_closest_point.Distance, SecondNumber="5")  # -> SmallerThan, OrEqualTo
larger_than = LargerThan(FirstNumber=curve_closest_point.Distance, SecondNumber="5")  # -> LargerThan, OrEqualTo
cull_pattern = CullPattern(List=area.Centroid, CullPattern=smaller_than.OrEqualTo)
cull_pattern_2 = CullPattern(List=area.Centroid, CullPattern=larger_than.LargerThan)
curve_closest_point_2 = CurveClosestPoint(Point=flatten(cull_pattern_2), Curve=projecttomesh.A)  # -> Point, Parameter, Distance
smaller_than_2 = SmallerThan(FirstNumber=curve_closest_point_2.Distance, SecondNumber="10")  # -> SmallerThan, OrEqualTo
larger_than_2 = LargerThan(FirstNumber=curve_closest_point.Distance, SecondNumber="10")  # -> LargerThan, OrEqualTo
cull_pattern_3 = CullPattern(List=flatten(cull_pattern_2), CullPattern=smaller_than_2.SmallerThan)
cull_pattern_4 = CullPattern(List=area.Centroid, CullPattern=larger_than_2.LargerThan)

surface_closest_point = SurfaceClosestPoint(Point=cull_pattern_3, Surface=surface)  # -> Point, UVPoint, Distance
geometry = Geometry(<brep referenced from the Rhino model>)
area_2 = Area(Geometry=geometry)  # -> Area, Centroid
evaluate_surface = EvaluateSurface(Surface=surface, Point=surface_closest_point.UVPoint)  # -> Point, Normal, UDirection, VDirection, Frame
xy_plane = XYPlane(Origin=area_2.Centroid)
orient = Orient(Geometry=geometry, Source=xy_plane, Target=evaluate_surface.Frame)  # -> Geometry, Transform

surface_closest_point_2 = SurfaceClosestPoint(Point=cull_pattern_4, Surface=surface)  # -> Point, UVPoint, Distance
geometry_2 = Geometry(<brep referenced from the Rhino model>)
area_3 = Area(Geometry=geometry_2)  # -> Area, Centroid
evaluate_surface_2 = EvaluateSurface(Surface=surface, Point=surface_closest_point_2.UVPoint)  # -> Point, Normal, UDirection, VDirection, Frame
xy_plane_2 = XYPlane(Origin=area_3.Centroid)
orient_2 = Orient(Geometry=geometry_2, Source=xy_plane_2, Target=evaluate_surface_2.Frame)  # -> Geometry, Transform

surface_closest_point_3 = SurfaceClosestPoint(Point=cull_pattern, Surface=surface)  # -> Point, UVPoint, Distance
geometry_3 = Geometry(<brep referenced from the Rhino model>)
area_4 = Area(Geometry=geometry_3)  # -> Area, Centroid
evaluate_surface_3 = EvaluateSurface(Surface=surface, Point=surface_closest_point_3.UVPoint)  # -> Point, Normal, UDirection, VDirection, Frame
xy_plane_3 = XYPlane(Origin=area_4.Centroid)
orient_3 = Orient(Geometry=geometry_3, Source=xy_plane_3, Target=evaluate_surface_3.Frame)  # -> Geometry, Transform
