# Grasshopper definition panel03-surfaceModulConnected.gh (Grasshopper 1.0.7)

Z = UnitZ(Factor=Slider(50, range=0..100))
crv = Curve(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)
extr = Extrude(Base=crv, Direction=Z)

number_slider = Slider(2, range=0..10)
number_slider_2 = Slider(4, range=0..10)
srf = Surface(extr)
edges = BrepEdges(Brep=srf)  # -> Naked, Interior, NonManifold
item = ListItem(List=edges.Naked, Index=0, Wrap=True)  # -> Item, Item1
divdist = DivideDistance(Curve=reparameterize(item.Item), Distance=number_slider_2)  # -> Points, Tangents, flatten(Parameters)
divdist_2 = DivideDistance(Curve=reparameterize(item.Item1), Distance=number_slider)  # -> Points, Tangents, flatten(Parameters)
num = Number(1)
merge = Merge(Data1=divdist.Parameters, Data2=num)
merge_2 = Merge(Data1=divdist_2.Parameters, Data2=num)
cset = CreateSet(List=merge)  # -> Set, Map
toggle = BooleanToggle(False)
cset_2 = CreateSet(List=merge_2)  # -> Set, Map
consec = ConsecutiveDomains(Numbers=cset.Set, Additive=toggle)
consec_2 = ConsecutiveDomains(Numbers=cset_2.Set, Additive=toggle)
graft = GraftTree(Tree=consec, IncludeEmptyLists=True, IncludeNullItems=True)
lng = ListLength(List=consec_2)
lng_2 = ListLength(List=consec)
multiplication = Multiplication(A=lng_2, B=lng)
repeat = RepeatData(Data=graft, Length=lng)  # -> flatten(Data)
repeat_2 = RepeatData(Data=consec_2, Length=multiplication)  # -> flatten(Data)
dom = ConstructDomain(DomainU=repeat, DomainV=repeat_2)
subsrf = Isotrim(Surface=reparameterize(srf), Domain=dom)

area = Area(Geometry=subsrf)  # -> Area, Centroid
multiplication_2 = Multiplication(A=number_slider_2, B=number_slider)
larger = LargerThan(FirstNumber=area.Area, SecondNumber=multiplication_2)  # -> LargerThan, OrEqualTo
cull = CullPattern(List=area.Centroid, CullPattern=larger.OrEqualTo)

crv_2 = Curve(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)
mesh = Mesh(extr)
Y = UnitY(Factor=1)
projecttomesh = CSharpScript(curve=crv_2, mesh=mesh, dir=Y)  # -> out, A; inputs curve: Curve, mesh: Mesh, dir: Vector3d
# ---------- projecttomesh: C# usings ----------
using System.IO;
using System.Linq;
using System.Data;
using System.Drawing;
using System.Reflection;
using System.Windows.Forms;
using System.Xml;
using System.Xml.Linq;
using System.Runtime.InteropServices;

using Rhino.DocObjects;
using Rhino.Collections;
using GH_IO;
using GH_IO.Serialization;
# ---------- projecttomesh: C# ----------
    if (null != curve && null != mesh && dir.IsValid)
    {
      var tol = RhinoDoc.ActiveDoc.ModelAbsoluteTolerance;
      A = Curve.ProjectToMesh(curve, mesh, dir, tol);
    }
# ---------- end projecttomesh ----------

number_slider_3 = Slider(9, range=0..15)
number_slider_4 = Slider(5, range=0..10)
planesrf = PlaneSurface(Plane=PlaneXY(0, 0, 0), XSize=number_slider_2, YSize=number_slider)
srf_2 = Surface(extr)

crv_cp = CurveClosestPoint(Point=cull, Curve=projecttomesh.A)  # -> Point, Parameter, Distance
smaller = SmallerThan(FirstNumber=crv_cp.Distance, SecondNumber=number_slider_4)  # -> SmallerThan, OrEqualTo
larger_2 = LargerThan(FirstNumber=crv_cp.Distance, SecondNumber=number_slider_4)  # -> LargerThan, OrEqualTo
cull_2 = CullPattern(List=cull, CullPattern=larger_2.LargerThan)
cull_3 = CullPattern(List=cull, CullPattern=smaller.OrEqualTo)

X = UnitX(Factor=Slider(15, range=0..100))
move = Move(Geometry=planesrf, Motion=X)  # -> Geometry, Transform
crv_3 = Curve([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])
srfsplit = SurfaceSplit(Surface=move.Geometry, Curves=crv_3)
split = SplitList(List=srfsplit, Index="1")  # -> ListA, ListB
srf_3 = Surface(split.ListA)

X_2 = UnitX(Factor=Slider(20, range=0..100))
move_2 = Move(Geometry=planesrf, Motion=X_2)  # -> Geometry, Transform
crv_4 = Curve([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])
srfsplit_2 = SurfaceSplit(Surface=move_2.Geometry, Curves=crv_4)
split_2 = SplitList(List=srfsplit_2, Index="1")  # -> ListA, ListB
srf_4 = Surface(split_2.ListA)

X_3 = UnitX(Factor=Slider(10, range=0..100))
move_3 = Move(Geometry=planesrf, Motion=X_3)  # -> Geometry, Transform
srf_5 = Surface(move_3.Geometry)

crv_cp_2 = CurveClosestPoint(Point=flatten(cull_2), Curve=projecttomesh.A)  # -> Point, Parameter, Distance
smaller_2 = SmallerThan(FirstNumber=crv_cp_2.Distance, SecondNumber=number_slider_3)  # -> SmallerThan, OrEqualTo
larger_3 = LargerThan(FirstNumber=crv_cp.Distance, SecondNumber=number_slider_3)  # -> LargerThan, OrEqualTo
cull_4 = CullPattern(List=flatten(cull_2), CullPattern=smaller_2.SmallerThan)
cull_5 = CullPattern(List=cull, CullPattern=larger_3.LargerThan)

geo = Geometry(srf_4)
srf_cp = SurfaceClosestPoint(Point=cull_3, Surface=srf_2)  # -> Point, UVPoint, Distance
area_2 = Area(Geometry=geo)  # -> Area, Centroid
evalsrf = EvaluateSurface(Surface=srf_2, Point=srf_cp.UVPoint)  # -> Point, Normal, UDirection, VDirection, Frame
xy = XYPlane(Origin=area_2.Centroid)
orient = Orient(Geometry=geo, Source=xy, Target=evalsrf.Frame)  # -> Geometry, Transform

geo_2 = Geometry(srf_3)
srf_cp_2 = SurfaceClosestPoint(Point=cull_4, Surface=srf_2)  # -> Point, UVPoint, Distance
area_3 = Area(Geometry=geo_2)  # -> Area, Centroid
evalsrf_2 = EvaluateSurface(Surface=srf_2, Point=srf_cp_2.UVPoint)  # -> Point, Normal, UDirection, VDirection, Frame
xy_2 = XYPlane(Origin=area_3.Centroid)
orient_2 = Orient(Geometry=geo_2, Source=xy_2, Target=evalsrf_2.Frame)  # -> Geometry, Transform

geo_3 = Geometry(srf_5)
srf_cp_3 = SurfaceClosestPoint(Point=cull_5, Surface=srf_2)  # -> Point, UVPoint, Distance
area_4 = Area(Geometry=geo_3)  # -> Area, Centroid
evalsrf_3 = EvaluateSurface(Surface=srf_2, Point=srf_cp_3.UVPoint)  # -> Point, Normal, UDirection, VDirection, Frame
xy_3 = XYPlane(Origin=area_4.Centroid)
orient_3 = Orient(Geometry=geo_3, Source=xy_3, Target=evalsrf_3.Frame)  # -> Geometry, Transform
