# Grasshopper definition projectCurveToSurface.gh (Grasshopper 1.0.7)

mesh = Mesh(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)
crv = Curve(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)
Z = UnitZ(Factor=1)
projecttomesh = CSharpScript(curve=crv, mesh=mesh, dir=Z)  # -> out, A; inputs curve: Curve, mesh: Mesh, dir: Vector3d
# ---------- projecttomesh: C# usings ----------
using System.IO;
using System.Linq;
using System.Data;
using System.Drawing;
using System.Reflection;
using System.Windows.Forms;
using System.Xml;
using System.Xml.Linq;
using System.Runtime.InteropServices;

using Rhino.DocObjects;
using Rhino.Collections;
using GH_IO;
using GH_IO.Serialization;
# ---------- projecttomesh: C# ----------
    if (null != curve && null != mesh && dir.IsValid)
    {
      var tol = RhinoDoc.ActiveDoc.ModelAbsoluteTolerance;
      A = Curve.ProjectToMesh(curve, mesh, dir, tol);
    }
# ---------- end projecttomesh ----------
pulltomesh = CSharpScript(curve=crv, mesh=mesh)  # -> out, A; inputs curve: Curve, mesh: Mesh
# ---------- pulltomesh: C# ----------
    if (null != curve && null != mesh)
    {
      var tol = RhinoDoc.ActiveDoc.ModelAbsoluteTolerance;
      A = curve.PullToMesh(mesh, tol);
    }
# ---------- end pulltomesh ----------
panel = Panel(projecttomesh.A)
panel_2 = Panel(pulltomesh.A)
